# Grasshopper definition Orthotic_Insole_Toolkit.ghx (Grasshopper 0.9.76)
# Orthotic Insole Toolkit

# ---- group: 01 Foot Scan
# Instructions: SETUP:
# 1. Import your foot scan STL into Rhino
# 2. Use Geometry Pipeline to connect the mesh
#    to the scan_mesh input of component 01.
# 3. Adjust sliders for each tool.
# 4. Tools flow left → right (01 → 08).
# 5. Right-click any output → Bake to add to Rhino.
file_path_optional = NumberSlider(Slider_Max=0, Slider_Min=0, Slider_Type=1, Slider_Value=0, Slider_Decimals=0)
_01_footscan = _01FootScanImport()  # -> port
# ---------- _01_footscan: Python ----------
import Rhino.Geometry as rg
import System, System.IO
# ─────────────────────────────────────────────────────────────────────────────
# TOOL 1 – Foot Scan Import & Plantar Surface Extraction
# Inputs : file_path (string), scan_mesh (Mesh - connect Geometry Pipeline)
# Outputs: foot_mesh, plantar_mesh, flat_curve, mesh_info
# ─────────────────────────────────────────────────────────────────────────────
foot_mesh    = None
plantar_mesh = None
flat_curve   = None
mesh_info    = "Connect mesh or set file_path to STL/OBJ."

try:
    m = scan_mesh
    if m is None and file_path:
        p = str(file_path)
        if System.IO.File.Exists(p):
            import Rhino
            doc = Rhino.RhinoDoc.ActiveDoc
            before = doc.Objects.Count
            doc.Import(p)
            found = []
            for i in range(before, doc.Objects.Count):
                geo = doc.Objects[i].Geometry
                if isinstance(geo, rg.Mesh):
                    found.append(geo)
            if found:
                combined = rg.Mesh()
                for mx in found: combined.Append(mx)
                m = combined

    if m is not None:
        foot_mesh = m
        m.FaceNormals.ComputeFaceNormals()
        m.Normals.ComputeNormals()

        # Extract plantar faces (normal.Z < -0.15 = pointing downward)
        plantar = rg.Mesh()
        vmap = {}
        for fi in range(m.Faces.Count):
            if m.FaceNormals[fi].Z < -0.15:
                face = m.Faces[fi]
                vis = [face.A, face.B, face.C] + ([] if face.IsTriangle else [face.D])
                nv = []
                for vi in vis:
                    if vi not in vmap:
                        vmap[vi] = plantar.Vertices.Count
                        plantar.Vertices.Add(m.Vertices[vi])
                    nv.append(vmap[vi])
                plantar.Faces.AddFace(*nv) if len(nv)==3 else plantar.Faces.AddFace(*nv)

        # Fallback: lowest 6 mm band
        if plantar.Faces.Count == 0:
            bb2 = m.GetBoundingBox(True); z_low = bb2.Min.Z; vmap2 = {}
            for fi in range(m.Faces.Count):
                face = m.Faces[fi]
                vis = [face.A, face.B, face.C] + ([] if face.IsTriangle else [face.D])
                if sum(1 for vi in vis if m.Vertices[vi].Z < z_low+6) >= 3:
                    nv = []
                    for vi in vis:
                        if vi not in vmap2:
                            vmap2[vi] = plantar.Vertices.Count
                            plantar.Vertices.Add(m.Vertices[vi])
                        nv.append(vmap2[vi])
                    plantar.Faces.AddFace(*nv) if len(nv)==3 else plantar.Faces.AddFace(*nv)

        if plantar.Faces.Count > 0:
            plantar.Compact(); plantar.Normals.ComputeNormals(); plantar.UnifyNormals()
            plantar_mesh = plantar
            flat = rg.Mesh()
            for v in plantar.Vertices: flat.Vertices.Add(rg.Point3d(v.X, v.Y, 0.0))
            for fi in range(plantar.Faces.Count):
                f = plantar.Faces[fi]
                flat.Faces.AddFace(f.A,f.B,f.C) if f.IsTriangle else flat.Faces.AddFace(f.A,f.B,f.C,f.D)
            flat.Normals.ComputeNormals(); flat.UnifyNormals()
            edges = flat.GetNakedEdges()
            if edges: flat_curve = max(edges, key=lambda c: c.GetLength())

        bb = m.GetBoundingBox(True)
        mesh_info = ("Foot Scan Loaded\nLength:{:.1f}mm Width:{:.1f}mm Height:{:.1f}mm\nFaces:{:d}".format(
            bb.Max.Y-bb.Min.Y, bb.Max.X-bb.Min.X, bb.Max.Z-bb.Min.Z, m.Faces.Count))
except Exception as _e:
    mesh_info = "Error: " + str(_e)
# ---------- end _01_footscan ----------

# ----
# Title: ORTHOTIC INSOLE TOOLKIT
# 8-tool parametric insole design for CNC/EVA milling & 3D printing.
s2_title = Panel("INSOLE OUTLINE")

# ---- group: 02 Insole Outline
offset_mm_negative_inward = NumberSlider(Slider_Max=0, Slider_Min=-15, Slider_Type=1, Slider_Value=-2, Slider_Decimals=1)
smoothing_0_1 = NumberSlider(Slider_Max=1, Slider_Min=0, Slider_Type=1, Slider_Value=0.3, Slider_Decimals=2)
_02_outline = _02InsoleOutline(Off=offset_mm_negative_inward, Sm=smoothing_0_1)  # -> port
#   port Off: Inward offset in mm
#   port Sm: 0=sharp 1=smooth
# ---------- _02_outline: Python ----------
import Rhino.Geometry as rg
# ─────────────────────────────────────────────────────────────────────────────
# TOOL 2 – Insole Outline Generator
# Inputs : flat_curve (Curve from 01), offset_mm (number), smoothing (0-1)
# Outputs: insole_outline, heel_pt, toe_pt, insole_length, insole_width
# ─────────────────────────────────────────────────────────────────────────────
insole_outline = None; heel_pt = None; toe_pt = None
insole_length  = 0.0;  insole_width = 0.0

try:
    if flat_curve is not None:
        crv = flat_curve
        od  = float(offset_mm)  if offset_mm  is not None else -2.0
        sm  = float(smoothing)  if smoothing  is not None else 0.3
        if od > 0: od = -od
        offs = crv.Offset(rg.Plane.WorldXY, od, 0.1, rg.CurveOffsetCornerStyle.Round)
        result = offs[0] if offs else crv
        if sm > 0.05:
            n  = max(24, int(60*sm)); dom = result.Domain
            pts = [result.PointAt(dom.ParameterAt(i/float(n))) for i in range(n+1)]
            f   = rg.Curve.CreateInterpolatedCurve(pts, 3)
            if f: result = f
        insole_outline = result
        bb = result.GetBoundingBox(True)
        cx = (bb.Min.X+bb.Max.X)/2.0
        insole_length = round(bb.Max.Y-bb.Min.Y, 2)
        insole_width  = round(bb.Max.X-bb.Min.X, 2)
        heel_pt = rg.Point3d(cx, bb.Min.Y, 0.0)
        toe_pt  = rg.Point3d(cx, bb.Max.Y, 0.0)
except Exception as _e:
    print("Outline error: "+str(_e))
# ---------- end _02_outline ----------

# ----
s3_title = Panel("MEDIAL ARCH")

# ---- group: 03 Arch
arch_height_mm_0_30 = NumberSlider(Slider_Max=30, Slider_Min=0, Slider_Type=1, Slider_Value=15, Slider_Decimals=1)
arch_peak_0_heel_1_toe = NumberSlider(Slider_Max=1, Slider_Min=0, Slider_Type=1, Slider_Value=0.35, Slider_Decimals=2)
arch_width_mm = NumberSlider(Slider_Max=60, Slider_Min=10, Slider_Type=1, Slider_Value=30, Slider_Decimals=1)
_03_arch = _03MedialArch(AH=arch_height_mm_0_30, AP=arch_peak_0_heel_1_toe, AW=arch_width_mm)  # -> port
#   port AH: Arch height mm
#   port AP: Peak position along foot (0-1)
#   port AW: Arch base width mm
# ---------- _03_arch: Python ----------
import Rhino.Geometry as rg, math
# ─────────────────────────────────────────────────────────────────────────────
# TOOL 3 – Medial Arch Height Mapper
# Inputs : insole_outline, arch_height (mm), arch_peak (0-1), arch_width (mm), foot_side (R/L)
# Outputs: arch_surface, arch_spine, arch_profiles
# ─────────────────────────────────────────────────────────────────────────────
arch_surface = None; arch_spine = None; arch_profiles = []
try:
    if insole_outline is not None:
        bb   = insole_outline.GetBoundingBox(True)
        flen = bb.Max.Y - bb.Min.Y; fwid = bb.Max.X - bb.Min.X
        ah   = float(arch_height) if arch_height is not None else 15.0
        ap   = float(arch_peak)   if arch_peak   is not None else 0.35
        aw   = float(arch_width)  if arch_width  is not None else 30.0
        side = str(foot_side).strip().upper() if foot_side else "R"
        med_x = bb.Min.X + fwid*0.12 if side=="R" else bb.Max.X - fwid*0.12
        y0 = bb.Min.Y+0.10*flen; y_pk = bb.Min.Y+ap*flen; y1 = bb.Min.Y+0.72*flen
        N  = 30; spine_pts = []
        for i in range(N+1):
            t    = i/float(N); y = y0+t*(y1-y0)
            t_pk = (y_pk-y0)/(y1-y0) if (y1-y0)>0 else 0.35
            z    = max(0.0, ah*math.exp(-((t-t_pk)**2)/0.06))
            spine_pts.append(rg.Point3d(med_x, y, z))
        arch_spine = rg.Curve.CreateInterpolatedCurve(spine_pts, 3)
        profs = []
        for i in range(N+1):
            t    = i/float(N); y = y0+t*(y1-y0)
            t_pk = (y_pk-y0)/(y1-y0) if (y1-y0)>0 else 0.35
            z    = max(0.0, ah*math.exp(-((t-t_pk)**2)/0.06))
            if z < 0.3: continue
            lw   = max(6.0, aw*(1.0-0.5*abs(t-t_pk)/max(t_pk,1-t_pk)))
            apl  = rg.Plane(rg.Point3d(med_x,y,0.0), rg.Vector3d.XAxis, rg.Vector3d.ZAxis)
            arc  = rg.Arc(apl, lw, math.pi).ToNurbsCurve()
            xf   = rg.Transform.Scale(rg.Plane(rg.Point3d(med_x,y,0.0),
                       rg.Vector3d.XAxis, rg.Vector3d.ZAxis), 1.0, 1.0, z/lw)
            arc.Transform(xf); profs.append(arc)
        arch_profiles = profs
        if len(profs)>=2:
            b = rg.Brep.CreateFromLoft(profs, rg.Point3d.Unset, rg.Point3d.Unset,
                                       rg.LoftType.Normal, False)
            if b: arch_surface = b[0]
except Exception as _e:
    print("Arch error: "+str(_e))
# ---------- end _03_arch ----------

# ----
foot_side = Panel("R")
s4_title = Panel("HEEL CUP")

# ---- group: 04 Heel Cup
cup_depth_mm = NumberSlider(Slider_Max=25, Slider_Min=0, Slider_Type=1, Slider_Value=12, Slider_Decimals=1)
cup_angle_degrees = NumberSlider(Slider_Max=30, Slider_Min=0, Slider_Type=1, Slider_Value=15, Slider_Decimals=1)
cup_width_0_1 = NumberSlider(Slider_Max=1, Slider_Min=0, Slider_Type=1, Slider_Value=0.75, Slider_Decimals=2)
_04_heelcup = _04HeelCup(CD=cup_depth_mm, CA=cup_angle_degrees, CW=cup_width_0_1)  # -> port
#   port CA: Cup wall angle degrees
#   port CW: Cup width as fraction of foot width
# ---------- _04_heelcup: Python ----------
import Rhino.Geometry as rg, math
# ─────────────────────────────────────────────────────────────────────────────
# TOOL 4 – Heel Cup Designer
# Inputs : insole_outline, cup_depth (mm), cup_angle (deg), cup_width_pct (0-1)
# Outputs: heel_cup_surface, heel_cup_info
# ─────────────────────────────────────────────────────────────────────────────
heel_cup_surface = None; heel_cup_info = ""
try:
    if insole_outline is not None:
        bb   = insole_outline.GetBoundingBox(True)
        flen = bb.Max.Y-bb.Min.Y; fwid = bb.Max.X-bb.Min.X
        cx   = (bb.Min.X+bb.Max.X)/2.0
        cd   = float(cup_depth)     if cup_depth     is not None else 12.0
        ca   = float(cup_angle)     if cup_angle     is not None else 15.0
        cwp  = float(cup_width_pct) if cup_width_pct is not None else 0.75
        half_w = fwid*cwp/2.0; heel_y = bb.Min.Y; heel_ey = bb.Min.Y+flen*0.28
        profs = []
        for i in range(13):
            t  = i/12.0; y = heel_y+t*(heel_ey-heel_y)
            r  = half_w*math.sqrt(max(0.0,1.0-t**2))
            if r<2.0: continue
            zw = max(0.0, cd*math.cos(math.radians(ca))*(1.0-0.4*t))
            base = rg.Point3d(cx,y,0.0)
            arc  = rg.Arc(rg.Plane(base,rg.Vector3d.XAxis,rg.Vector3d.ZAxis),r,math.pi).ToNurbsCurve()
            if r>0:
                xf = rg.Transform.Scale(rg.Plane(base,rg.Vector3d.XAxis,rg.Vector3d.ZAxis),
                                        1.0,1.0,zw/r)
                arc.Transform(xf); profs.append(arc)
        if len(profs)>=2:
            b = rg.Brep.CreateFromLoft(profs,rg.Point3d.Unset,rg.Point3d.Unset,
                                       rg.LoftType.Normal,False)
            if b: heel_cup_surface = b[0]
        heel_cup_info = "Heel Cup\nDepth:{:.1f}mm Angle:{:.1f}deg Width:{:.1f}mm".format(cd,ca,half_w*2)
except Exception as _e:
    heel_cup_info = "Error: "+str(_e)
# ---------- end _04_heelcup ----------

# ----
s5_title = Panel("METATARSAL DOME")

# ---- group: 05 Metatarsal Dome
dome_height_mm = NumberSlider(Slider_Max=15, Slider_Min=0, Slider_Type=1, Slider_Value=6, Slider_Decimals=1)
dome_x_pos_0_1 = NumberSlider(Slider_Max=1, Slider_Min=0, Slider_Type=1, Slider_Value=0.5, Slider_Decimals=2)
dome_y_pos_0_1 = NumberSlider(Slider_Max=1, Slider_Min=0, Slider_Type=1, Slider_Value=0.63, Slider_Decimals=2)
dome_radius_mm = NumberSlider(Slider_Max=40, Slider_Min=5, Slider_Type=1, Slider_Value=20, Slider_Decimals=1)
_05_metdome = _05MetatarsalDome(DH=dome_height_mm, DX=dome_x_pos_0_1, DY=dome_y_pos_0_1, DR=dome_radius_mm)  # -> port
#   port DH: Dome height mm
#   port DX: Medial-lateral position (0-1)
#   port DY: Heel-toe position (0-1)
#   port DR: Dome base radius mm
# ---------- _05_metdome: Python ----------
import Rhino.Geometry as rg, math
# ─────────────────────────────────────────────────────────────────────────────
# TOOL 5 – Metatarsal Dome
# Inputs : insole_outline, dome_height (mm), dome_x_pct (0-1), dome_y_pct (0-1), dome_radius (mm)
# Outputs: dome_surface, dome_centre
# ─────────────────────────────────────────────────────────────────────────────
dome_surface = None; dome_centre = None
try:
    if insole_outline is not None:
        bb   = insole_outline.GetBoundingBox(True)
        flen = bb.Max.Y-bb.Min.Y; fwid = bb.Max.X-bb.Min.X
        dh   = float(dome_height) if dome_height  is not None else 6.0
        dxp  = float(dome_x_pct)  if dome_x_pct   is not None else 0.5
        dyp  = float(dome_y_pct)  if dome_y_pct   is not None else 0.63
        dr   = float(dome_radius) if dome_radius   is not None else 20.0
        cx   = bb.Min.X+dxp*fwid; cy = bb.Min.Y+dyp*flen
        dome_centre = rg.Point3d(cx,cy,0.0)
        N = 20; prof_pts = []
        for i in range(N+1):
            t = i/float(N)
            prof_pts.append(rg.Point3d(cx+dr*math.sin(t*math.pi), cy, dh*math.sin(t*math.pi)))
        pc = rg.Curve.CreateInterpolatedCurve(prof_pts,3)
        if pc:
            rev = rg.RevSurface.Create(pc, rg.Line(rg.Point3d(cx,cy,0),rg.Point3d(cx,cy,dh)),
                                       0, 2*math.pi)
            if rev: dome_surface = rev.ToBrep()
except Exception as _e:
    print("Dome error: "+str(_e))
# ---------- end _05_metdome ----------

# ----
s6_title = Panel("POSTING / WEDGING")

# ---- group: 06 Posting
rf_medial_deg = NumberSlider(Slider_Max=10, Slider_Min=0, Slider_Type=1, Slider_Value=0, Slider_Decimals=1)
rf_lateral_deg = NumberSlider(Slider_Max=10, Slider_Min=0, Slider_Type=1, Slider_Value=0, Slider_Decimals=1)
ff_medial_deg = NumberSlider(Slider_Max=10, Slider_Min=0, Slider_Type=1, Slider_Value=0, Slider_Decimals=1)
ff_lateral_deg = NumberSlider(Slider_Max=10, Slider_Min=0, Slider_Type=1, Slider_Value=0, Slider_Decimals=1)
_06_posting = _06PostingWedging(RFM=rf_medial_deg, RFL=rf_lateral_deg, FFM=ff_medial_deg, FFL=ff_lateral_deg)  # -> port
#   port RFM: Rearfoot medial post degrees
#   port RFL: Rearfoot lateral post degrees
#   port FFM: Forefoot medial post degrees
#   port FFL: Forefoot lateral post degrees
# ---------- _06_posting: Python ----------
import Rhino.Geometry as rg, math
# ─────────────────────────────────────────────────────────────────────────────
# TOOL 6 – Posting / Wedging
# Inputs : insole_outline, rf_med_deg, rf_lat_deg, ff_med_deg, ff_lat_deg
# Outputs: rf_post_brep, ff_post_brep, posting_info
# ─────────────────────────────────────────────────────────────────────────────
rf_post_brep = None; ff_post_brep = None; posting_info = ""
try:
    if insole_outline is not None:
        bb   = insole_outline.GetBoundingBox(True)
        flen = bb.Max.Y-bb.Min.Y; fwid = bb.Max.X-bb.Min.X
        rmd  = float(rf_med_deg) if rf_med_deg is not None else 0.0
        rld  = float(rf_lat_deg) if rf_lat_deg is not None else 0.0
        fmd  = float(ff_med_deg) if ff_med_deg is not None else 0.0
        fld  = float(ff_lat_deg) if ff_lat_deg is not None else 0.0

        def wedge(y1, y2, med_d, lat_d):
            cx2  = (bb.Min.X+bb.Max.X)/2.0
            mh   = fwid/2.0*math.tan(math.radians(abs(med_d)))
            lh   = fwid/2.0*math.tan(math.radians(abs(lat_d)))
            def bz(x):
                rel = (x-cx2)/(fwid/2.0) if fwid>0 else 0
                return -abs(mh)*abs(rel) if rel<0 else -abs(lh)*abs(rel)
            tr = rg.PolylineCurve([rg.Point3d(bb.Min.X,y1,0),rg.Point3d(bb.Max.X,y1,0),
                                   rg.Point3d(bb.Max.X,y2,0),rg.Point3d(bb.Min.X,y2,0),rg.Point3d(bb.Min.X,y1,0)])
            br = rg.PolylineCurve([rg.Point3d(bb.Min.X,y1,bz(bb.Min.X)),rg.Point3d(bb.Max.X,y1,bz(bb.Max.X)),
                                   rg.Point3d(bb.Max.X,y2,bz(bb.Max.X)),rg.Point3d(bb.Min.X,y2,bz(bb.Min.X)),
                                   rg.Point3d(bb.Min.X,y1,bz(bb.Min.X))])
            ls = rg.Brep.CreateFromLoft([tr,br],rg.Point3d.Unset,rg.Point3d.Unset,rg.LoftType.Straight,False)
            return ls[0] if ls else None

        if abs(rmd)>0.01 or abs(rld)>0.01:
            rf_post_brep = wedge(bb.Min.Y, bb.Min.Y+0.35*flen, rmd, rld)
        if abs(fmd)>0.01 or abs(fld)>0.01:
            ff_post_brep = wedge(bb.Min.Y+0.65*flen, bb.Max.Y, fmd, fld)
        posting_info = "Posting\nRF Med:{:.1f} Lat:{:.1f}\nFF Med:{:.1f} Lat:{:.1f}".format(rmd,rld,fmd,fld)
except Exception as _e:
    posting_info = "Error: "+str(_e)
# ---------- end _06_posting ----------

# ----
s7_title = Panel("INSOLE ASSEMBLY")

# ---- group: 07 Assembly
top_cover_mm = NumberSlider(Slider_Max=4, Slider_Min=0.5, Slider_Type=1, Slider_Value=1.5, Slider_Decimals=1)
shell_mm = NumberSlider(Slider_Max=10, Slider_Min=1, Slider_Type=1, Slider_Value=4, Slider_Decimals=1)
base_mm = NumberSlider(Slider_Max=6, Slider_Min=1, Slider_Type=1, Slider_Value=2, Slider_Decimals=1)
_07_assembly = _07InsoleAssembly(TC=top_cover_mm, Sh=shell_mm, Ba=base_mm)  # -> port
#   port TC: Top cover thickness mm
#   port Sh: Shell thickness mm
#   port Ba: Base thickness mm
# ---------- _07_assembly: Python ----------
import Rhino.Geometry as rg
# ─────────────────────────────────────────────────────────────────────────────
# TOOL 7 – Insole Assembly & Thickness Control
# Inputs : insole_outline, arch_surface, heel_cup_surface, dome_surface,
#          rf_post_brep, ff_post_brep, top_cover_mm, shell_mm, base_mm
# Outputs: insole_shell, insole_solid, assembly_info
# ─────────────────────────────────────────────────────────────────────────────
insole_shell = None; insole_solid = None; assembly_info = ""
try:
    if insole_outline is not None:
        bb   = insole_outline.GetBoundingBox(True)
        flen = bb.Max.Y-bb.Min.Y; fwid = bb.Max.X-bb.Min.X
        tc   = float(top_cover_mm) if top_cover_mm is not None else 1.5
        sh   = float(shell_mm)     if shell_mm     is not None else 4.0
        ba   = float(base_mm)      if base_mm      is not None else 2.0
        total = tc+sh+ba

        crv = insole_outline
        if not crv.IsClosed: crv = crv.ToNurbsCurve()
        caps = rg.Brep.CreatePlanarBreps([crv], 0.01)
        if caps:
            extruded = []
            for cap in caps:
                ex = cap.Faces[0].CreateExtrusion(rg.Vector3d(0,0,-total), True)
                if ex: extruded.append(ex)
            if extruded:
                insole_shell = extruded[0]
                parts = [insole_shell]
                for g in [arch_surface, heel_cup_surface, dome_surface, rf_post_brep, ff_post_brep]:
                    if g is not None: parts.append(g)
                if len(parts)>1:
                    j = rg.Brep.JoinBreps(parts, 0.1)
                    insole_solid = j[0] if j else insole_shell
                else:
                    insole_solid = insole_shell
        assembly_info = ("Assembly\nTop:{:.1f} Shell:{:.1f} Base:{:.1f} Total:{:.1f}mm\n"
                         "Footprint:{:.0f}x{:.0f}mm".format(tc,sh,ba,total,flen,fwid))
except Exception as _e:
    assembly_info = "Error: "+str(_e)
# ---------- end _07_assembly ----------

# ----
s8_title = Panel("EXPORT + ROCKER")

# ---- group: 08 Export+Rocker
rocker_angle_deg = NumberSlider(Slider_Max=25, Slider_Min=0, Slider_Type=1, Slider_Value=10, Slider_Decimals=1)
rocker_apex_0_heel_1_toe = NumberSlider(Slider_Max=1, Slider_Min=0, Slider_Type=1, Slider_Value=0.5, Slider_Decimals=2)
# Export Notes: MANUFACTURING OUTPUTS
# CNC/EVA: Right-click export_brep → Bake
#   then File > Export Selected (STL or STEP).
# 3D Print: Bake insole_solid → export STL.
# Rocker 2D: Bake rocker_outline → export DXF.
# Shoe Last integration: connect last surface
#   to insole_outline input of 02.
_08_export = _08ExportRocker(RA=rocker_angle_deg, RAP=rocker_apex_0_heel_1_toe)  # -> port
#   port RA: Rocker bottom angle degrees
#   port RAP: Rocker apex position (0-1)
# ---------- _08_export: Python ----------
import Rhino.Geometry as rg, math
# ─────────────────────────────────────────────────────────────────────────────
# TOOL 8 – Export-Ready Brep + 2D Rocker-Bottom Outline
# Inputs : insole_solid, insole_outline, rocker_angle (deg), rocker_apex_pct (0-1)
# Outputs: export_brep, rocker_outline, rocker_profile, export_info
# ─────────────────────────────────────────────────────────────────────────────
export_brep = None; rocker_outline = None; rocker_profile = None
export_info = "Connect 07 Assembly output."
try:
    if insole_solid is not None:
        rep = insole_solid.DuplicateBrep()
        rep.MergeCoplanarFaces(0.01)
        export_brep = rep
        export_info = "Export brep ready  Faces:{:d}".format(rep.Faces.Count)

    if insole_outline is not None:
        bb   = insole_outline.GetBoundingBox(True)
        flen = bb.Max.Y-bb.Min.Y; cx = (bb.Min.X+bb.Max.X)/2.0
        ra   = float(rocker_angle)    if rocker_angle    is not None else 10.0
        rap  = float(rocker_apex_pct) if rocker_apex_pct is not None else 0.50
        apex = bb.Min.Y+rap*flen; tan_ = math.tan(math.radians(ra))

        # Side-view rocker profile
        prof = [rg.Point3d(cx, bb.Min.Y+i/60.0*flen,
                max(0.0,-(bb.Min.Y+i/60.0*flen-apex))*tan_*-1) for i in range(61)]
        rocker_profile = rg.Curve.CreateInterpolatedCurve(prof, 3)

        # 2-D rocker contact outline projected onto rocker plane
        n  = rg.NurbsCurve = insole_outline.ToNurbsCurve()
        dom = n.Domain; pts2 = []
        for i in range(101):
            pt = n.PointAt(dom.ParameterAt(i/100.0))
            z  = -(pt.Y-apex)*tan_ if pt.Y>apex else 0.0
            pts2.append(rg.Point3d(pt.X, pt.Y, z))
        pts2.append(pts2[0])
        rocker_outline = rg.Curve.CreateInterpolatedCurve(pts2, 3)
except Exception as _e:
    export_info = "Error: "+str(_e)
# ---------- end _08_export ----------
