# Grasshopper definition test_slider_python.ghx (Grasshopper 0.9.76)
# Minimal test

slider = NumberSlider(Slider_Max=10, Slider_Min=0, Slider_Type=1, Slider_Value=5, Slider_Decimals=1)
testpy = TestPython(x=slider)  # -> port
# ---------- testpy: Python ----------
a = x
# ---------- end testpy ----------
